# Dynamo custom node CalculateTotalAreaVolume.dyf (Dynamo 2.3.0.5885)
# category: CarbonNodes
# Calculate the total area or volume from a list of areas or volume numbers
# packages: archi-lab.net 2020.23.13

input = Input(input: List)
mass_addition = Custom[Mass Addition](list=input)  # package archi-lab.net; This node will attempt to sum all elements contained within it.
OUT = Output(mass_addition)  # "OUT:List"
