# Dynamo custom node GeometryCalculateAreaVolume.dyf (Dynamo 2.3.0.5885)
# category: CarbonNodes
# Calculate the area or volume of element geometry through solids and surfaces

input = Input(input: Revit.Elements.Element)
geometry = Element.Geometry(element=input)
volume = Solid.Volume(solid=geometry)
convert_between_units = DynamoConvert(volume, MeasurementType="Volume", FromConversion="CubicMillimeter", ToConversion="CubicMeters")  # graph output
Solid_Volume = Output(convert_between_units)  # "Solid.Volume:List"
area = Solid.Area(solid=geometry)
convert_between_units_2 = DynamoConvert(area, MeasurementType="Area", FromConversion="SquareMillimeter", ToConversion="SquareMeter")  # graph output
Solid_Area = Output(convert_between_units_2)  # "Solid.Area:List"
faces = Element.Faces(element=input)
area_2 = Surface.Area(surface=faces)
convert_between_units_3 = DynamoConvert(area_2, MeasurementType="Area", FromConversion="SquareMillimeter", ToConversion="SquareMeter")  # graph output
Surface_Area = Output(convert_between_units_3)  # "Surface.Area:List"
