# Dynamo graph EmbodiedCarbon-InPlaceFamily.dyn (Dynamo 2.3.0.5885)
# packages: archi-lab.net 2020.23.13

# group: Select Family Geometry
select_model_element = DSModelElementSelection()  # 1 picked in the model
select_model_elements = DSModelElementsSelection()  # 3 picked in the model
watch = Watch(select_model_elements)

# group: Calculate Areas or Volumes of Geometries
geometry = Element.Geometry(element=select_model_element)
volume = Solid.Volume(solid=geometry)
convert_between_units = DynamoConvert(volume, MeasurementType="Volume", FromConversion="CubicMillimeter", ToConversion="CubicMeters")
area = Solid.Area(solid=geometry)
convert_between_units_2 = DynamoConvert(area, MeasurementType="Area", FromConversion="SquareMillimeter", ToConversion="SquareMeter")
faces = Element.Faces(element=select_model_element)
area_2 = Surface.Area(surface=faces)
convert_between_units_3 = DynamoConvert(area_2, MeasurementType="Area", FromConversion="SquareMillimeter", ToConversion="SquareMeter")
list_create = List.Create(item0=convert_between_units, item1=convert_between_units_2, item2=convert_between_units_3)
watch_2 = Watch(list_create)

# group: Calculate Total Area or Volume
list_create_2 = List.Create(item0=convert_between_units_2)
flatten = List.Flatten(list=list_create_2)
watch_3 = Watch(flatten)
mass_addition = Custom[Mass Addition](list=flatten)  # package archi-lab.net; This node will attempt to sum all elements contained within it.
watch_4 = Watch(mass_addition)

# group: Select Construction Stage
string = StringInput("A4")
string_2 = StringInput("C1")
string_3 = StringInput("C2")
string_4 = StringInput("C3")
string_5 = StringInput("C4")
string_6 = StringInput("D")
string_7 = StringInput("A1-A3")

# group: Select Excel File with EPD Data
file_path = Filename("C:\Users\jocelyn.tang\Documents\EPDTestRevitInput.xlsx")

# group: Extract EPD Data from Excel File
file_from_path = FileObject(path=file_path)
string_8 = StringInput("Sheet1")
boolean = BoolSelector(false)
boolean_2 = BoolSelector(true)
importExcel = Data.ImportExcel(file=file_from_path, sheetName=string_8, readAsStrings=boolean, showExcel=boolean_2)
list_create_3 = List.Create(item0=importExcel)
watch_5 = Watch(importExcel)

# group: Parameter
parameter_name = StringInput("EPD Product")

# group: Extract Product Names
python_script = Python(IN[0]=list_create_3)
# ---------- python_script.python (23 lines) ----------
# Load the Python Standard and DesignScript Libraries
import sys
import clr
clr.AddReference('ProtoGeometry')
from Autodesk.DesignScript.Geometry import *

# Store List of EPD Products as Array
data = IN[0]

# Create list to store product name
prodNames = []

try:
# Loop through lists in array and extract product name
	for list in data:
		for item in list:
			prodNames.append(str(item[1]))
			OUT = prodNames
	
except Exception as e:
	OUT = "An error occured: {}".format(e)
	# Print error on console
	print("Error: {}".format(e))
# ----------------------------------------
list_create_4 = List.Create(item0=python_script)
watch_6 = Watch(python_script)

# group: Select EPD Product Name
index_of_product_names_list = StringInput("1")
python_script_2 = Python(IN[0]=list_create_4, IN[1]=index_of_product_names_list)
# ---------- python_script_2.python (22 lines) ----------
# Load the Python Standard and DesignScript Libraries
import sys
import clr
clr.AddReference('ProtoGeometry')
from Autodesk.DesignScript.Geometry import *

# Get inputs
prodNames = IN[0]
nameIndex = int(IN[1])

# Declare string variable for selected product name
selectName = ""

try:
	for item in prodNames:
		selectName = str(item[nameIndex])
		OUT = selectName

except Exception as e:
	OUT = "An error occured: {}".format(e)
	# Print error on console
	print("Error: {}".format(e))
# ----------------------------------------
watch_7 = Watch(python_script_2)

# group: Calculate Embodied Carbon for Geometry based on Selected EPD
python_script_3 = Python(IN[0]=list_create_3, IN[1]=string_7, IN[2]=index_of_product_names_list, IN[3]=mass_addition)
# ---------- python_script_3.python (65 lines) ----------
# Load the Python Standard and DesignScript Libraries
import clr
clr.AddReference('ProtoGeometry')
from Autodesk.DesignScript.Geometry import *

clr.AddReference("RevitAPI")
from Autodesk.Revit.DB import *
from Autodesk.Revit.DB import Transaction

clr.AddReference("RevitServices")
import RevitServices
from RevitServices.Persistence import DocumentManager
from RevitServices.Transactions import TransactionManager

# Store List of EPD Products as Array
data = IN[0]

# Store rest of inputs
stage = IN[1]
product = int(IN[2])
area = IN[3]

# Create variable to store carbon value
gwp = []

# Create index value for construction stage
stageIndex = 0

# Create list/array to store embodied carbon calculation
carbon = []

try:
	if stage == "A1-A3":
		stageIndex = 8
	elif stage == "A4":
		stageIndex = 9
	elif stage == "C1":
		stageIndex = 10
	elif stage == "C2":
		stageIndex = 11
	elif stage == "C3":
		stageIndex = 12
	elif stage == "C4":
		stageIndex = 13
	elif stage == "D":
		stageIndex = 14

	# Loop through data lists and get all GWP values for construction stage
	for list in data:
		for item in list:
			gwp.append(item[stageIndex])
			
	# Get GWP for specific product
	chosenGWP = int(gwp[product])
	
	# Calculate embodied carbon for product in family
	carb = chosenGWP * area
	carbon.append(carb)
	
	OUT = carbon
	
except Exception as e:
	OUT = "An error occured: {}".format(e)
	# Print error on console
	print("Error: {}".format(e))
# ----------------------------------------
watch_8 = Watch(python_script_3)

# group: Set Family Instance Parameter to Store EPD Product Name
setParameterByName = Element.SetParameterByName(element=select_model_element, parameterName=parameter_name, value=python_script_2)
watch_9 = Watch(setParameterByName)

# group: Parameter
parameter_name_2 = StringInput("Embodied Carbon")

# group: Set Family Instance Parameter to Store EPD Product Name
setParameterByName_2 = Element.SetParameterByName(element=select_model_element, parameterName=parameter_name_2, value=python_script_3)
watch_10 = Watch(setParameterByName_2)
