# Dynamo graph EmbodiedCarbon-SystemFamilyTool-S.dyn "EmbodiedCarbon-SystemFamilyTool" (Dynamo 2.3.0.5885)
# packages: archi-lab.net 2020.23.13

# group: Select Family Category
categories = Categories("OST_Walls")

# group: Extract Element Parameters
all_elements_of_category = ElementsOfCategory(Category=categories)
watch = Watch(all_elements_of_category)
parameters = Element.Parameters(element=all_elements_of_category)
watch_2 = Watch(parameters)

# group: Filter Elements and Extract Area Parameter
list_create = List.Create(item0=parameters)
family_name_list_index = StringInput("34")
parameter_name_list_index = StringInput("1")
string = StringInput("WT01")
string_2 = StringInput("WT03")
string_3 = StringInput("WT11")
python_script = Python(IN[0]=list_create, IN[1]=family_name_list_index, IN[2]=parameter_name_list_index, IN[3]=string, IN[4]=string_2, IN[5]=string_3)
# ---------- python_script.python (43 lines) ----------
# Load the Python Standard and DesignScript Libraries
import sys
import clr
clr.AddReference('ProtoGeometry')
from Autodesk.DesignScript.Geometry import *

# Get inputs
data = IN[0]
param = int(IN[2])
filterIndex = int(IN[1])

# Declare filters
filter1 = IN[3]
filter2 = IN[4]
filter3 = IN[5]

# Create output lists
elements = []
paramValue = []

index = 0

try:
# Loop through lists in array and extract product name
	for list in data:
		index += 1
		for item in list:
			if filter1 in str(item[filterIndex]):
				elements.append(str(item[param]))
			elif filter2 in str(item[filterIndex]):
				elements.append(str(item[param]))
			elif filter3 in str(item[filterIndex]):
				elements.append(str(item[param]))
				
	for item in elements:
		new_string = ''.join((x for x in item if x.isdigit()))
		paramValue.append(str(new_string))		
		OUT = paramValue
	
except Exception as e:
	OUT = "An error occured: {}".format(e)
	# Print error on console
	print("Error: {}".format(e))
# ----------------------------------------
watch_3 = Watch(python_script)

# group: Calculate Total Area
list_create_2 = List.Create(item0=python_script)
mass_addition = Custom[Mass Addition](list=list_create_2)  # package archi-lab.net; This node will attempt to sum all elements contained within it.
watch_4 = Watch(mass_addition)

# group: Select Excel File with EPD Data
file_path = Filename("C:\Users\jocelyn.tang\Documents\EPDTestRevitInput.xlsx")

# group: Extract EPD Data from Excel File
file_from_path = FileObject(path=file_path)
string_4 = StringInput("Sheet1")
boolean = BoolSelector(false)
boolean_2 = BoolSelector(true)
importExcel = Data.ImportExcel(file=file_from_path, sheetName=string_4, readAsStrings=boolean, showExcel=boolean_2)
watch_5 = Watch(importExcel)
list_create_3 = List.Create(item0=importExcel)

# group: Extract Product Names
python_script_2 = Python(IN[0]=list_create_3)
# ---------- python_script_2.python (23 lines) ----------
# Load the Python Standard and DesignScript Libraries
import sys
import clr
clr.AddReference('ProtoGeometry')
from Autodesk.DesignScript.Geometry import *

# Store List of EPD Products as Array
data = IN[0]

# Create list to store product name
prodNames = []

try:
# Loop through lists in array and extract product name
	for list in data:
		for item in list:
			prodNames.append(str(item[1]))
			OUT = prodNames
	
except Exception as e:
	OUT = "An error occured: {}".format(e)
	# Print error on console
	print("Error: {}".format(e))
# ----------------------------------------
watch_6 = Watch(python_script_2)
list_create_4 = List.Create(item0=python_script_2)

# group: Select EPD Product Name
index_of_product_names_list = StringInput("1")
python_script_3 = Python(IN[0]=list_create_4, IN[1]=index_of_product_names_list)
# ---------- python_script_3.python (22 lines) ----------
# Load the Python Standard and DesignScript Libraries
import sys
import clr
clr.AddReference('ProtoGeometry')
from Autodesk.DesignScript.Geometry import *

# Get inputs
prodNames = IN[0]
nameIndex = int(IN[1])

# Declare string variable for selected product name
selectName = ""

try:
	for item in prodNames:
		selectName = str(item[nameIndex])
		OUT = selectName

except Exception as e:
	OUT = "An error occured: {}".format(e)
	# Print error on console
	print("Error: {}".format(e))
# ----------------------------------------
watch_7 = Watch(python_script_3)

# group: Select Construction Stage
string_5 = StringInput("A4")
string_6 = StringInput("C1")
string_7 = StringInput("C2")
string_8 = StringInput("C3")
string_9 = StringInput("C4")
string_10 = StringInput("A1-A3")
string_11 = StringInput("D")

# group: Calculate Embodied Carbon for Geometry based on Selected EPD
python_script_4 = Python(IN[0]=list_create_3, IN[1]=string_10, IN[2]=index_of_product_names_list, IN[3]=list_create_2)
# ---------- python_script_4.python (67 lines) ----------
# Load the Python Standard and DesignScript Libraries
import clr
clr.AddReference('ProtoGeometry')
from Autodesk.DesignScript.Geometry import *

clr.AddReference("RevitAPI")
from Autodesk.Revit.DB import *
from Autodesk.Revit.DB import Transaction

clr.AddReference("RevitServices")
import RevitServices
from RevitServices.Persistence import DocumentManager
from RevitServices.Transactions import TransactionManager

# Store List of EPD Products as Array
data = IN[0]

# Store rest of inputs
stage = IN[1]
product = int(IN[2])
area = IN[3]

# Create variable to store carbon value
gwp = []

# Create index value for construction stage
stageIndex = 0

# Create list/array to store embodied carbon calculation
carbon = []

try:
	if stage == "A1-A3":
		stageIndex = 8
	elif stage == "A4":
		stageIndex = 9
	elif stage == "C1":
		stageIndex = 10
	elif stage == "C2":
		stageIndex = 11
	elif stage == "C3":
		stageIndex = 12
	elif stage == "C4":
		stageIndex = 13
	elif stage == "D":
		stageIndex = 14

	# Loop through data lists and get all GWP values for construction stage
	for list in data:
		for item in list:
			gwp.append(item[stageIndex])
			
	# Get GWP for specific product
	chosenGWP = int(gwp[product])
	
	for list in area:
		for item in list:
			# Calculate embodied carbon for product in family
			carb = chosenGWP * int(item)
			carbon.append(carb)
	
	OUT = carbon
	
except Exception as e:
	OUT = "An error occured: {}".format(e)
	# Print error on console
	print("Error: {}".format(e))
# ----------------------------------------
watch_8 = Watch(python_script_4)

# group: Filter Elements
string_12 = StringInput("WT01")
string_13 = StringInput("WT03")
string_14 = StringInput("WT11")
python_script_5 = Python(IN[0]=string_12, IN[1]=string_13, IN[2]=string_14)
# ---------- python_script_5.python (32 lines) ----------
import clr
 
clr.AddReference("RevitServices")
import RevitServices
from RevitServices.Persistence import DocumentManager
doc =  DocumentManager.Instance.CurrentDBDocument
 
clr.AddReference("RevitNodes")
import Revit
clr.ImportExtensions(Revit.Elements)
clr.ImportExtensions(Revit.GeometryConversion)
 
clr.AddReference("RevitAPI")
from Autodesk.Revit.DB import *


# Get input serarch terms
filter1 = IN[0]
filter2 = IN[1]
filter3 = IN[2]

# Defining the search terms
search_terms = [filter1, filter2, filter3]

# Collecting all wall instances
walls_collector = FilteredElementCollector(doc).OfCategory(BuiltInCategory.OST_Walls).WhereElementIsNotElementType()

# Filtering walls with specific family type names
filtered_walls = [wall for wall in walls_collector if any(term in wall.Name for term in search_terms)]

# Returning the list of filtered walls
OUT = filtered_walls
# ----------------------------------------
watch_9 = Watch(python_script_5)

# group: Parameter
parameter_name = StringInput("EPD Product")

# group: Set Family Instance Parameter to Store EPD Product Name
setParameterByName = Element.SetParameterByName(element=python_script_5, parameterName=parameter_name, value=python_script_3)
watch_10 = Watch(setParameterByName)

# group: Parameter
parameter_name_2 = StringInput("Embodied Carbon")

# group: Set Family Instance Parameter to Store EPD Product Name
setParameterByName_2 = Element.SetParameterByName(element=python_script_5, parameterName=parameter_name_2, value=python_script_4)
watch_11 = Watch(setParameterByName_2)
