# Dynamo graph EmbodiedCarbonFamilyTool.dyn "EmbodiedCarbon" (Dynamo 2.3.0.5885)
# packages: archi-lab.net 2020.23.13

# group: Select Family Geometry
select_model_element = DSModelElementSelection()  # 1 picked in the model
select_model_elements = DSModelElementsSelection()  # 3 picked in the model
watch = Watch(select_model_elements)

# group: Choose to Calculate Areas or Volumes of Geometries
geometry = Element.Geometry(element=select_model_element)
volume = Solid.Volume(solid=geometry)
convert_between_units = DynamoConvert(volume, MeasurementType="Volume", FromConversion="CubicMillimeter", ToConversion="CubicMeters")
area = Solid.Area(solid=geometry)
convert_between_units_2 = DynamoConvert(area, MeasurementType="Area", FromConversion="SquareMillimeter", ToConversion="SquareMeter")
faces = Element.Faces(element=select_model_element)
area_2 = Surface.Area(surface=faces)
convert_between_units_3 = DynamoConvert(area_2, MeasurementType="Area", FromConversion="SquareMillimeter", ToConversion="SquareMeter")
list_create = List.Create(item0=convert_between_units, item1=convert_between_units_2, item2=convert_between_units_3)
watch_2 = Watch(list_create)

# group: Calculate Total Area or Volume
list_create_2 = List.Create(item0=convert_between_units_2)
flatten = List.Flatten(list=list_create_2)
watch_3 = Watch(flatten)
mass_addition = Custom[Mass Addition](list=flatten)  # package archi-lab.net; This node will attempt to sum all elements contained within it.
watch_4 = Watch(mass_addition)

# group: Input Product Number
product_number = StringInput("1")

# group: Choose whether parameter is area or volume
string = StringInput("area")
string_2 = StringInput("volume")

# group: Create Family Type Parameter to Store Area Value
python_script = Python(IN[0]=product_number, IN[1]=mass_addition, IN[2]=string)
# ---------- python_script.python (49 lines) ----------
# Load the Python Standard and DesignScript Libraries
import clr
clr.AddReference('ProtoGeometry')
from Autodesk.DesignScript.Geometry import *

clr.AddReference("RevitAPI")
from Autodesk.Revit.DB import *
from Autodesk.Revit.DB import Transaction

clr.AddReference("RevitServices")
import RevitServices
from RevitServices.Persistence import DocumentManager
from RevitServices.Transactions import TransactionManager

# Set current open family file as variable
doc = DocumentManager.Instance.CurrentDBDocument

# Get the active family document
familyManager = doc.FamilyManager

# Get Product Number
prodNumber = IN[0]

# Get Area value
total_area = IN[1]

# Get Area or Volume Parameter Name
paramType = IN[2]

try:
	# Begin new Revit Transaction
	TransactionManager.Instance.EnsureInTransaction(doc)

	# Create new Area Type Family Parameter
	paramName = "prod-" + str(prodNumber) + "-" + str(paramType)
	areaParam = familyManager.AddParameter(paramName, BuiltInParameterGroup.PG_DATA, ParameterType.Integer, False)

	# Set Parameter value
	familyManager.Set(areaParam, total_area)

	# Commit transaction changes and close transaction
	TransactionManager.Instance.TransactionTaskDone()
	
	OUT = "Parameter created and value set successfully"
	
except Exception as e:
	OUT = "An error occured: {}".format(e)
	# Print error on console
	print("Error: {}".format(e))
# ----------------------------------------
watch_5 = Watch(python_script)

# group: Select Excel File with EPD Data
file_path = Filename("C:\Users\jocelyn.tang\Documents\EPDTestRevitInput.xlsx")

# group: Extract EPD Data from Excel File
file_from_path = FileObject(path=file_path)
string_3 = StringInput("Sheet1")
boolean = BoolSelector(false)
boolean_2 = BoolSelector(true)
importExcel = Data.ImportExcel(file=file_from_path, sheetName=string_3, readAsStrings=boolean, showExcel=boolean_2)
watch_6 = Watch(importExcel)
list_create_3 = List.Create(item0=importExcel)

# group: Extract Product Names
python_script_2 = Python(IN[0]=list_create_3)
# ---------- python_script_2.python (23 lines) ----------
# Load the Python Standard and DesignScript Libraries
import sys
import clr
clr.AddReference('ProtoGeometry')
from Autodesk.DesignScript.Geometry import *

# Store List of EPD Products as Array
data = IN[0]

# Create list to store product name
prodNames = []

try:
# Loop through lists in array and extract product name
	for list in data:
		for item in list:
			prodNames.append(str(item[1]))
			OUT = prodNames
	
except Exception as e:
	OUT = "An error occured: {}".format(e)
	# Print error on console
	print("Error: {}".format(e))
# ----------------------------------------
watch_7 = Watch(python_script_2)
list_create_4 = List.Create(item0=python_script_2)

# group: Select EPD Product Name
index_of_product_names_list = StringInput("1")
python_script_3 = Python(IN[0]=list_create_4, IN[1]=index_of_product_names_list)
# ---------- python_script_3.python (22 lines) ----------
# Load the Python Standard and DesignScript Libraries
import sys
import clr
clr.AddReference('ProtoGeometry')
from Autodesk.DesignScript.Geometry import *

# Get inputs
prodNames = IN[0]
nameIndex = int(IN[1])

# Declare string variable for selected product name
selectName = ""

try:
	for item in prodNames:
		selectName = str(item[nameIndex])
		OUT = selectName

except Exception as e:
	OUT = "An error occured: {}".format(e)
	# Print error on console
	print("Error: {}".format(e))
# ----------------------------------------
watch_8 = Watch(python_script_3)

# group: Create Family Type Parameter to Store EPD Product Name
python_script_4 = Python(IN[0]=product_number, IN[1]=python_script_3)
# ---------- python_script_4.python (46 lines) ----------
# Load the Python Standard and DesignScript Libraries
import clr
clr.AddReference('ProtoGeometry')
from Autodesk.DesignScript.Geometry import *

clr.AddReference("RevitAPI")
from Autodesk.Revit.DB import *
from Autodesk.Revit.DB import Transaction

clr.AddReference("RevitServices")
import RevitServices
from RevitServices.Persistence import DocumentManager
from RevitServices.Transactions import TransactionManager

# Set current open family file as variable
doc = DocumentManager.Instance.CurrentDBDocument

# Get the active family document
familyManager = doc.FamilyManager

# Get Product Number
prodNumber = IN[0]

# Get product name value
product = str(IN[1])

try:
	# Begin new Revit Transaction
	TransactionManager.Instance.EnsureInTransaction(doc)

	# Create new Area Type Family Parameter
	paramName = "EPD prod-" + str(prodNumber)
	newParam = familyManager.AddParameter(paramName, BuiltInParameterGroup.PG_DATA, ParameterType.Text, False)

	# Set Parameter value
	familyManager.Set(newParam, product)

	# Commit transaction changes and close transaction
	TransactionManager.Instance.TransactionTaskDone()
	
	OUT = "Parameter created and value set successfully"
	
except Exception as e:
	OUT = "An error occured: {}".format(e)
	# Print error on console
	print("Error: {}".format(e))
# ----------------------------------------
watch_9 = Watch(python_script_4)

# group: Select Construction Stage
string_4 = StringInput("C2")
string_5 = StringInput("A1-A3")
string_6 = StringInput("A4")
string_7 = StringInput("C1")
string_8 = StringInput("C3")
string_9 = StringInput("C4")
string_10 = StringInput("D")

# group: Calculate Embodied Carbon for Geometry based on Selected EPD and Store as Family Type Parameter
python_script_5 = Python(IN[0]=list_create_3, IN[1]=string_4, IN[2]=index_of_product_names_list, IN[3]=mass_addition, IN[4]=product_number)
# ---------- python_script_5.python (82 lines) ----------
# Load the Python Standard and DesignScript Libraries
import clr
clr.AddReference('ProtoGeometry')
from Autodesk.DesignScript.Geometry import *

clr.AddReference("RevitAPI")
from Autodesk.Revit.DB import *
from Autodesk.Revit.DB import Transaction

clr.AddReference("RevitServices")
import RevitServices
from RevitServices.Persistence import DocumentManager
from RevitServices.Transactions import TransactionManager

# Set current open family file as variable
doc = DocumentManager.Instance.CurrentDBDocument

# Get the active family document
familyManager = doc.FamilyManager

# Store List of EPD Products as Array
data = IN[0]

# Store rest of inputs
stage = IN[1]
product = int(IN[2])
area = int(IN[3])
prodNumber = IN[4]

# Create variable to store carbon value
gwp = []

# Create index value for construction stage
stageIndex = 0

try:
	if stage == "A1-A3":
		stageIndex = 8
	elif stage == "A4":
		stageIndex = 9
	elif stage == "C1":
		stageIndex = 10
	elif stage == "C2":
		stageIndex = 11
	elif stage == "C3":
		stageIndex = 12
	elif stage == "C4":
		stageIndex = 13
	elif stage == "D":
		stageIndex = 14

	# Loop through data lists and get all GWP values for construction stage
	for list in data:
		for item in list:
			gwp.append(item[stageIndex])
			
	# Get GWP for specific product
	chosenGWP = int(gwp[product])
	
	# Calculate embodied carbon for product in family
	carbon = chosenGWP * area
	
	# Store carbon value as parameter
	# Begin new Revit Transaction
	TransactionManager.Instance.EnsureInTransaction(doc)

	# Create new Area Type Family Parameter
	paramName = "prod-" + str(prodNumber) + "-" + str(stage) + "-Carbon"
	newParam = familyManager.AddParameter(paramName, BuiltInParameterGroup.PG_DATA, ParameterType.Integer, False)

	# Set Parameter value
	familyManager.Set(newParam, carbon)

	# Commit transaction changes and close transaction
	TransactionManager.Instance.TransactionTaskDone()
	
	OUT = carbon
	
except Exception as e:
	OUT = "An error occured: {}".format(e)
	# Print error on console
	print("Error: {}".format(e))
# ----------------------------------------
watch_10 = Watch(python_script_5)
